# Dynamo graph script.dyn "SolidBoolScriptExampleFileVersion6" (Dynamo 2.19.0.5377)

constraint = StringInput("")  # graph input
parseJSON = Data.ParseJSON(json=constraint)
code_block = CodeBlock { 3;-2; }
takeEveryNthItem = List.TakeEveryNthItem(list=parseJSON@L2, n=code_block.out0, offset=code_block.out1)
code_block_2 = CodeBlock { -1; }
takeEveryNthItem_2 = List.TakeEveryNthItem(list=parseJSON@L2, n=code_block.out0, offset=code_block_2)
takeEveryNthItem_3 = List.TakeEveryNthItem(list=parseJSON@L2, n=code_block.out0)
byCoordinates = Point.ByCoordinates(x=takeEveryNthItem, y=takeEveryNthItem_2, z=takeEveryNthItem_3)
chop = List.Chop(list=byCoordinates@L2, lengths=code_block.out0)
code_block_3 = CodeBlock { true; }
byPoints = PolyCurve.ByPoints(points=chop@@L2, connectLastToFirst=code_block_3)
boolean = BoolSelector(false)
clean = List.Clean(list=byPoints@L2, preserveIndices=boolean)
byPatch = Surface.ByPatch(closedCurve=clean)
byJoinedSurfaces = Solid.ByJoinedSurfaces(facesOfSolid=byPatch)
color_palette = ColorPalette({R: 0, G: 0, B: 0, A: 38})
byGeometryColor = Modifiers.GeometryColor.ByGeometryColor(geometry=byJoinedSurfaces, color=color_palette)
file_path = Filename("..\\..\\..\\..\\..\\..\\..\\Temp\\Proposal.txt")
readText = FileSystem.ReadText(file=file_path)
file_path_2 = Filename("..\\..\\..\\..\\..\\..\\..\\Temp\\Contraints.txt")
readText_2 = FileSystem.ReadText(file=file_path_2)
proposal = StringInput("")  # graph input
parseJSON_2 = Data.ParseJSON(json=proposal)
code_block_4 = CodeBlock { 3;-2; }
takeEveryNthItem_4 = List.TakeEveryNthItem(list=parseJSON_2@L2, n=code_block_4.out0, offset=code_block_4.out1)
code_block_5 = CodeBlock { -1; }
takeEveryNthItem_5 = List.TakeEveryNthItem(list=parseJSON_2@L2, n=code_block_4.out0, offset=code_block_5)
takeEveryNthItem_6 = List.TakeEveryNthItem(list=parseJSON_2@L2, n=code_block_4.out0)
byCoordinates_2 = Point.ByCoordinates(x=takeEveryNthItem_4, y=takeEveryNthItem_5, z=takeEveryNthItem_6)
chop_2 = List.Chop(list=byCoordinates_2@L2, lengths=code_block_4.out0)
code_block_6 = CodeBlock { true; }
byPoints_2 = PolyCurve.ByPoints(points=chop_2@@L2, connectLastToFirst=code_block_6)
boolean_2 = BoolSelector(false)
clean_2 = List.Clean(list=byPoints_2@L2, preserveIndices=boolean_2)
byPatch_2 = Surface.ByPatch(closedCurve=clean_2)
byJoinedSurfaces_2 = Solid.ByJoinedSurfaces(facesOfSolid=byPatch_2)
code_block_7 = CodeBlock { 0; }
centroid = Solid.Centroid(solid=byJoinedSurfaces_2)
X = Point.X(point=centroid)
centroid_2 = Solid.Centroid(solid=byJoinedSurfaces)
X_2 = Point.X(point=centroid_2)
boundingBox = Geometry.BoundingBox(geometry=byJoinedSurfaces_2)
maxPoint = BoundingBox.MaxPoint(boundingBox=boundingBox)
X_3 = Point.X(point=maxPoint)
boundingBox_2 = Geometry.BoundingBox(geometry=byJoinedSurfaces)
maxPoint_2 = BoundingBox.MaxPoint(boundingBox=boundingBox_2)
X_4 = Point.X(point=maxPoint_2)
code_block_8 = CodeBlock(x1=X, x2=X_2, x3=X_3, x4=X_4) { x1;x2;x3;x4; }
sub = code_block_8.x1@L1 - code_block_8.x2
abs = Math.Abs(number=sub)
sub_2 = code_block_8.x1 - code_block_8.x3
abs_2 = Math.Abs(number=sub_2)
sub_3 = abs - abs_2
sub_4 = code_block_8.x2 - code_block_8.x4
abs_3 = Math.Abs(number=sub_4)
sub_5 = sub_3@L2 - abs_3
gt = code_block_7 > sub_5
code_block_9 = CodeBlock { 0; }
Y = Point.Y(point=centroid)
Y_2 = Point.Y(point=centroid_2)
Y_3 = Point.Y(point=maxPoint)
Y_4 = Point.Y(point=maxPoint_2)
code_block_10 = CodeBlock(x1=Y, x2=Y_2, x3=Y_3, x4=Y_4) { x1;x2;x3;x4; }
sub_6 = code_block_10.x1@L1 - code_block_10.x2
abs_4 = Math.Abs(number=sub_6)
sub_7 = code_block_10.x1 - code_block_10.x3
abs_5 = Math.Abs(number=sub_7)
sub_8 = abs_4 - abs_5
sub_9 = code_block_10.x2 - code_block_10.x4
abs_6 = Math.Abs(number=sub_9)
sub_10 = sub_8@L2 - abs_6
gt_2 = code_block_9 > sub_10
code_block_11 = CodeBlock { 0; }
Z = Point.Z(point=centroid)
Z_2 = Point.Z(point=centroid_2)
Z_3 = Point.Z(point=maxPoint)
Z_4 = Point.Z(point=maxPoint_2)
code_block_12 = CodeBlock(x1=Z, x2=Z_2, x3=Z_3, x4=Z_4) { x1;x2;x3;x4; }
sub_11 = code_block_12.x1@L1 - code_block_12.x2
abs_7 = Math.Abs(number=sub_11)
sub_12 = code_block_12.x1 - code_block_12.x3
abs_8 = Math.Abs(number=sub_12)
sub_13 = abs_7 - abs_8
sub_14 = code_block_12.x2 - code_block_12.x4
abs_9 = Math.Abs(number=sub_14)
sub_15 = sub_13@L2 - abs_9
gt_3 = code_block_11 > sub_15
and_ = And(bool0=gt, bool1=gt_2, bool2=gt_3)
filterByBoolMask = List.FilterByBoolMask(list=byJoinedSurfaces, mask=and_@L2)
isEmpty = List.IsEmpty(list=filterByBoolMask.in@L2)
filterByBoolMask_2 = List.FilterByBoolMask(list=byJoinedSurfaces_2, mask=isEmpty)
boolean_3 = BoolSelector(false)
clean_3 = List.Clean(list=filterByBoolMask.in, preserveIndices=boolean_3)
differenceAll = Solid.DifferenceAll(solid=filterByBoolMask_2.out, others=clean_3)
list_create = List.Create(item0=filterByBoolMask_2.in, item1=differenceAll)
conflict = Watch3D(list_create)  # graph output
contraint = Watch3D(byJoinedSurfaces)  # graph output
